# Grasshopper definition Component_Bool-Diff.gh (Grasshopper 1.0.7)
# plug-ins: MeshEdit Components, Pufferfish, Kangaroo Components

pipeline = GeometryPipeline(
    GroupByLayer=False,
    GroupByType=False,
    IncludeHidden=True,
    IncludeLocked=True,
    LayerFilter="Prototype2::Component1::Closed",
    NameFilter="*",
    SublayerFiltering=True,
    TypeFilter=32)
pipeline_2 = GeometryPipeline(
    GroupByLayer=False,
    GroupByType=False,
    IncludeHidden=True,
    IncludeLocked=True,
    LayerFilter="Prototype2::Component1::Cells",
    NameFilter="*",
    SublayerFiltering=True,
    TypeFilter=32)
pipeline_3 = GeometryPipeline(
    GroupByLayer=False,
    GroupByType=False,
    IncludeHidden=True,
    IncludeLocked=True,
    LayerFilter="Prototype2::*Closed",
    NameFilter="*",
    SublayerFiltering=True,
    TypeFilter=32)

# ----
# Print Settings
layer_height = Slider(9, range=0..140)
layer_width = Slider(11, range=0..40)

# ---- group: Neighbouring Cells
area = MeshArea(Mesh=pipeline_2)  # -> Area, Centroid
area_2 = MeshArea(Mesh=pipeline_3)  # -> Area, Centroid
cp = ClosestPoint(Point=area.Centroid, Cloud=area_2.Centroid)  # -> ClosestPoint, CPIndex, Distance
cull_i = CullIndex(List=pipeline_3, Indices=cp.CPIndex, Wrap=True)

# ---- group: Boolean Mesh
offmsh = OffsetMesh(Mesh=cull_i, Distance=layer_width, BothSides=False, CreateSolid=False)
munion = MeshUnion(Meshes=flatten(offmsh))
alignvert = AlignVertices(Mesh=munion, Tolerance=0.01)  # -> Result, Count
weldvertices = MeshWeldVertices(Mesh=alignvert.Result, Tolerance=0.01)  # -> RuntimeMessage, Mesh
clean = CombineClean(Meshes=weldvertices.Mesh)
unim = UnifyMesh(Mesh=clean)  # -> Result, Count

# ----
cullf = CullFaces()
