# Grasshopper definition Continuous Toolpath.gh (Grasshopper 1.0.7)
# plug-ins: Anemone, MetaHopper

pipeline = GeometryPipeline(
    GroupByLayer=True,
    GroupByType=False,
    IncludeHidden=True,
    IncludeLocked=True,
    LayerFilter="ToolPaths SP",
    NameFilter="*",
    SublayerFiltering=True,
    TypeFilter=1)
pipeline_2 = GeometryPipeline(
    GroupByLayer=True,
    GroupByType=False,
    IncludeHidden=True,
    IncludeLocked=True,
    LayerFilter="ToolPaths::*",
    NameFilter="*",
    SublayerFiltering=True,
    TypeFilter=4)

# ---- group: Final Single Layer Check
lng = ListLength(List=pipeline_2)
larger = LargerThan(FirstNumber=lng, SecondNumber=1)  # -> LargerThan, OrEqualTo
tstat = TreeStatistics(Tree=lng)  # -> Paths, Length, Count
cull = CullPattern(List=tstat.Paths, CullPattern=flatten(larger.LargerThan))
cull_2 = CullPattern(List=pipeline_2, CullPattern=larger.LargerThan)
item = ListItem(List=cull, Index=0, Wrap=True)
branch = TreeBranch(Tree=pipeline_2, Path=item, MaintainPaths=True)

# ----
crv_cp = CurveClosestPoint(Point=pipeline, Curve=pipeline_2)  # -> Point, Parameter, Distance
seam = Seam(Curve=pipeline_2, Seam=crv_cp.Parameter)
lng_2 = ListLength(List=flatten(seam))  # -> expr("x-2", Length)
loop_start = LoopStart(Repeat=lng_2, Trigger=Button(), Data=flatten(seam))  # -> port, Counter, Data
# Adjust Seams
panel = Panel(loop_start.Counter)
item_2 = ListItem(List=loop_start.Data, Index=loop_start.Counter, Wrap=True)  # -> Item, Item1
end = EndPoints(Curve=item_2.Item)  # -> Start, End
crv_cp_2 = CurveClosestPoint(Point=end.End, Curve=item_2.Item1)  # -> Point, Parameter, Distance
seam_2 = Seam(Curve=item_2.Item1, Seam=crv_cp_2.Parameter)
replace = ReplaceItems(List=loop_start.Data, Item=seam_2, Indices=expr("x+1", loop_start.Counter), Wrap=False)
loop_end = LoopEnd(port=loop_start.port, Exit=False, Data=replace, TimeOutVal=0, pausedState=False, state="Output last")

# ---- group: Select and Visualize
number_slider = Slider(22, range=0..100)
addition = Addition(A=number_slider, B=Slider(1, range=0..10))
dom = ConstructDomain(DomainStart=number_slider, DomainEnd=addition)
subset = SubList(List=flatten(seam), Domain=dom, Wrap=True)  # -> List, Index

# ----
layer_width = Slider(4, range=0..10)
len = Length(Curve=loop_end)
expression = Expression(x=len, y=layer_width, Expression="1-(2*y/x)")
lng_3 = ListLength(List=expression)
dup = DuplicateData(Data=0, Number=lng_3, Order=True)
merge = Merge(Data1=simplify(graft(dup)), Data2=simplify(graft(expression)))
shatter = Shatter(Curve=reparameterize(simplify(graft(loop_end))), Parameters=merge)
item_3 = ListItem(List=shatter, Index=Slider(0, range=0..1), Wrap=True)
end_2 = EndPoints(Curve=flatten(item_3))  # -> Start, End
shift = ShiftList(List=end_2.Start, Shift=1, Wrap=True)
ln = Line(StartPoint=end_2.End, EndPoint=shift)
cull_i = CullIndex(List=ln, Indices=-1, Wrap=True)
merge_2 = Merge(Data1=item_3, Data2=cull_i)
join = JoinCurves(Curves=flatten(merge_2), Preserve=False)
number_slider_2 = Slider(0.07046, range=0.001..0.999)

# ---- group: Z-Continuity
explode = Explode(Curve=join, Recursive=True)  # -> Segments, Vertices
pdecon = Deconstruct(Point=explode.Vertices)  # -> XComponent, YComponent, ZComponent
graph = QuickGraph(pdecon.ZComponent, SortOrder=0)
onoff = EnableDisableObject(Enabled=Toggle(True), AllObjects_Object=[explode, pdecon, graph])

# ----
addition_2 = Addition(A=number_slider_2, B=Slider(0.02423, range=0..0.12))
merge_3 = Merge(Data1=number_slider_2, Data2=addition_2)
min = Minimum(A=merge_3, B=0.999)
merge_4 = Merge(Data1=0, Data2=min)
shatter_2 = Shatter(Curve=reparameterize(join), Parameters=merge_4)
item_4 = ListItem(List=shatter_2, Index=Slider(1, range=0..10), Wrap=True)
curvepoint = PointOnCurve(item_4, parameter=0.557)
