# Grasshopper definition GCode Generator.gh (Grasshopper 1.0.7)

pipeline = GeometryPipeline(
    GroupByLayer=False,
    GroupByType=False,
    IncludeHidden=True,
    IncludeLocked=True,
    LayerFilter="Continuous Toolpath0",
    NameFilter="*",
    SublayerFiltering=True,
    TypeFilter=4)
redpline = Reduce(Polyline=pipeline, Tolerance=Slider(0.2, range=0..0.5))  # -> Polyline, Reduction
crv = Curve(redpline.Polyline)

# ----
# Check Direction
end = EndPoints(Curve=crv)  # -> Start, End
pdecon = Deconstruct(Point=end.Start)  # -> XComponent, YComponent, ZComponent
pdecon_2 = Deconstruct(Point=end.End)  # -> XComponent, YComponent, ZComponent
larger = LargerThan(FirstNumber=pdecon.ZComponent, SecondNumber=pdecon_2.ZComponent)  # -> LargerThan, OrEqualTo
flip = FlipCurve(Curve=crv)  # -> Curve, Flag
weave = Weave(Pattern=larger.LargerThan, Stream0=crv, Stream1=flip.Curve, NullGaps=False)

# ----
# Select Points
explode = Explode(Curve=weave, Recursive=True)  # -> Segments, Vertices
split = SplitList(List=explode.Vertices, Index=1500)  # -> ListA, ListB
list = ValueList({"Test": 0, "Full": 1}, selected="Test")
filter = StreamFilter(Gate=list, Stream0=split.ListA, Stream1=explode.Vertices)

temperature = Slider(205, range=0..1000)
bed_temperature = Slider(60, range=0..1000)

# ----
# Specify Printer
list_2 = ValueList({"Creality CR-X": 0, "Staubli 3DRobotPrinting": 1}, selected="Creality CR-X")

# ----
# Generate Gcode
button = Button()

python = GhPythonScript(printer=list_2, Pt=filter, Temp=temperature, bTemp=bed_temperature, create=button)  # -> out, a; inputs printer: Int32, Pt: list of Point3d, Temp: Boolean, create: Boolean
# ---------- python: Python ----------
__author__ = "maxla"
__version__ = "2021.03.18"

import rhinoscriptsyntax as rs
import os

#Global Variables:
gCode = []
startCode = []
mainCode = []
endCode = []
ptApproach = rs.CreatePoint(0, 0, 400)
ptStart = Pt[0] + ptApproach
ptEnd = Pt[len(Pt)-1] + ptApproach
curDir = os.getcwd()

#Printer specific start code:       Replace temperature etc.
if printer == 0: #Creality CR-X
    file = curDir+'\Start\Creality_CR-X.txt'
    print(file)
    with open(file, 'r') as startFile:
        startContent = startFile.readlines()
        for line in startContent:
            x = line[:-1]
            startCode.append(x)

if printer == 0: #Staubli 3DRobotPrinting
    file = curDir+'\Start\Staubli_3DRobotPrinting.txt'
    print(file)
    with open(file, 'r') as startFile:
        startContent = startFile.readlines()
        for line in startContent:
            x = line[:-1]
            startCode.append(x)

#Add Approach 

#Main code
ptStartString = 'G1 X' + str(format(ptStart[0], '.2f')) + ' Y' + str(format(ptStart[1], '.2f')) + ' Z' + str(format(ptStart[2], '.2f'))
mainCode.append(ptStartString)
for i in range(len(Pt)):
    ptX = format(Pt[i][0], '.2f')
    ptY = format(Pt[i][1], '.2f')
    ptZ = format(Pt[i][2], '.2f')
    if i > 0:
        ptZl = format(Pt[i-1][2], '.2f')
    else: ptZl = -1
    if ptZ == ptZl:
        mainCode.append('G1 X' + ptX + ' Y' + ptY)
    else:
        mainCode.append('G1 X' + str(ptX) + ' Y' + str(ptY) + ' Z' + str(ptZ))

print(mainCode[5])



#Append code:
gCode = startCode + mainCode + endCode


#Generate GCode:
if create == True:
    gcodeFile = open('print_file.gcode', 'w+')
    for i in range(len(gCode)):
        gcodeFile.write(gCode[i] + '\n')
    gcodeFile.close()
# ---------- end python ----------
