# Grasshopper definition gcode_generator.gh (Grasshopper 1.0.7)

pipeline = GeometryPipeline(
    GroupByLayer=False,
    GroupByType=False,
    IncludeHidden=True,
    IncludeLocked=True,
    LayerFilter="Continuous Toolpath0",
    NameFilter="*",
    SublayerFiltering=True,
    TypeFilter=4)

# ----
# Check Direction
end = EndPoints(Curve=pipeline)  # -> Start, End
pdecon = Deconstruct(Point=end.Start)  # -> XComponent, YComponent, ZComponent
pdecon_2 = Deconstruct(Point=end.End)  # -> XComponent, YComponent, ZComponent
larger = LargerThan(FirstNumber=pdecon.ZComponent, SecondNumber=pdecon_2.ZComponent)  # -> LargerThan, OrEqualTo
flip = FlipCurve(Curve=pipeline)  # -> Curve, Flag
weave = Weave(Pattern=larger.LargerThan, Stream0=pipeline, Stream1=flip.Curve, NullGaps=False)

# ----
# Select Points
explode = Explode(Curve=weave, Recursive=True)  # -> Segments, Vertices
split = SplitList(List=explode.Vertices, Index=500)  # -> ListA, ListB
list = ValueList({"Test": 0, "Full": 1}, selected="Test")
filter = StreamFilter(Gate=list, Stream0=split.ListA, Stream1=explode.Vertices)

# ----
# Specify Printer
list_2 = ValueList({"Creality CR-X": 0, "Staubli 3DRobotPrinting": 1}, selected="Creality CR-X")

python = GhPythonScript(Printer=list_2, Pt=filter)  # -> Out, A
