# Grasshopper definition continuous_toolpaths.gh (Grasshopper 1.0.7)
# plug-ins: Anemone, MetaHopper, Pufferfish, EleFront

# ----
# Refer to Geometry
pipeline = GeometryPipeline(
    GroupByLayer=True,
    GroupByType=False,
    IncludeHidden=True,
    IncludeLocked=True,
    LayerFilter="ToolPaths SP",
    NameFilter="*",
    SublayerFiltering=True,
    TypeFilter=1)
# Continuous Toolpath
# In this tutorial toolpaths of different layers are connected to one single continuous toolpath. Ensure that the provided initial curves are closed and in layers ordered relating to the printing layers. Every layer should contain one single closed curve.
pipeline_2 = GeometryPipeline(
    GroupByLayer=True,
    GroupByType=False,
    IncludeHidden=True,
    IncludeLocked=True,
    LayerFilter="ToolPaths::*",
    NameFilter="*",
    SublayerFiltering=True,
    TypeFilter=4)

# ----
# Final single curve Check
lng = ListLength(List=pipeline_2)
larger = LargerThan(FirstNumber=lng, SecondNumber=1)  # -> LargerThan, OrEqualTo
tstat = TreeStatistics(Tree=lng)  # -> Paths, Length, Count
cull = CullPattern(List=tstat.Paths, CullPattern=flatten(larger.LargerThan))
item = ListItem(List=cull, Index=0, Wrap=True)
branch = TreeBranch(Tree=pipeline_2, Path=item, MaintainPaths=True)

# ----
# Reduce Polyline
# Reduce the amount of vertices in the polylines within a certain tolerance. Adjust this tolerance according to the layer width. Check manually whether the tolerance doesn't result in a reduction of detail.
number_slider = Slider(0.5, range=0..1)
redpline = Reduce(Polyline=pipeline_2, Tolerance=number_slider)  # -> Polyline, Reduction

# ---- group: Initial Seam Allignment
crv_cp = CurveClosestPoint(Point=pipeline, Curve=redpline.Polyline)  # -> Point, Parameter, Distance
seam = Seam(Curve=pipeline_2, Seam=crv_cp.Parameter)

# ----
# Select and Preview
number_slider_2 = Slider(22, range=0..100)
addition = Addition(A=number_slider_2, B=Slider(1, range=0..10))
dom = ConstructDomain(DomainStart=number_slider_2, DomainEnd=addition)
subset = SubList(List=flatten(seam), Domain=dom, Wrap=True)  # -> List, Index

# ----
# Allign Seams
# To properly connect the curves the seams need to be alligned.
lng_2 = ListLength(List=flatten(seam))  # -> expr("x-2", Length)
loop_start = LoopStart(Repeat=lng_2, Trigger=Button(), Data=flatten(seam))  # -> port, Counter, Data
panel = Panel(loop_start.Counter)
item_2 = ListItem(List=loop_start.Data, Index=loop_start.Counter, Wrap=True)  # -> Item, Item1
end = EndPoints(Curve=item_2.Item)  # -> Start, End
crv_cp_2 = CurveClosestPoint(Point=end.End, Curve=item_2.Item1)  # -> Point, Parameter, Distance
seam_2 = Seam(Curve=item_2.Item1, Seam=crv_cp_2.Parameter)
replace = ReplaceItems(List=loop_start.Data, Item=seam_2, Indices=expr("x+1", loop_start.Counter), Wrap=False)
loop_end = LoopEnd(port=loop_start.port, Exit=False, Data=replace, TimeOutVal=0, pausedState=False, state="Output last")

# ---- group: Trim End
layer_width = Slider(4, range=0..10)
len = Length(Curve=loop_end)
expression = Expression(x=len, y=layer_width, Expression="1-(2*y/x)")
lng_3 = ListLength(List=expression)
# The curves are trimmed at the end with the size of the layer width. A line is then generated from the end of the curve to the start of the curve in the next layer. The curves and lines are joined in a single continuous curve.
dup = DuplicateData(Data=0, Number=lng_3, Order=True)
merge = Merge(Data1=simplify(graft(dup)), Data2=simplify(graft(expression)))
# Continuous Curve
shatter = Shatter(Curve=reparameterize(simplify(graft(loop_end))), Parameters=merge)
item_3 = ListItem(List=shatter, Index=Slider(0, range=0..1), Wrap=True)

# ---- group: Connect and Join
end_2 = EndPoints(Curve=flatten(item_3))  # -> Start, End
shift = ShiftList(List=end_2.Start, Shift=1, Wrap=True)
ln = Line(StartPoint=end_2.End, EndPoint=shift)
cull_i = CullIndex(List=ln, Indices=-1, Wrap=True)
merge_2 = Merge(Data1=item_3, Data2=cull_i)
join = JoinCurves(Curves=flatten(merge_2), Preserve=False)

# ----
# Bake
tstat_2 = TreeStatistics(Tree=join)  # -> Paths, Length, Count
dpath = DeconstructPath(Branch=tstat_2.Paths)  # -> flatten(Indices)
concat = Concatenate(FragmentA="Continuous Toolpath", FragmentC=dpath)
bake = Button()
attributes = DefineObjectAttributes(Layer=concat, Color=ColourSwatch(SwatchColor=RGB(224, 224, 224)))
# Check
# Several ways to check and preview the toolpath are provided here. When issues occur, it is probably the most efficient to solve them manually after baking.
bake_2 = BakeObjects(Geometry=join, Attributes=graft(attributes), BakeName="Continuous Toolpath", Bake=bake)

# ---- group: Z-Continuity
explode = Explode(Curve=join, Recursive=True)  # -> Segments, Vertices; disabled
pdecon = Deconstruct(Point=explode.Vertices)  # -> XComponent, YComponent, ZComponent; disabled
should_gradually_increase = QuickGraph(pdecon.ZComponent, SortOrder=0)  # disabled
onoff = EnableDisableObject(Enabled=Toggle(False), AllObjects_Object=[explode, pdecon, should_gradually_increase])

# ---- group: Preview Part
end_3 = EndPoints(Curve=join)  # -> Start, End
merge_3 = Merge(Data1=end_3.Start, Data2=end_3.End)
pdecon_2 = Deconstruct(Point=merge_3)  # -> XComponent, YComponent, ZComponent
hideshow = HideShowObjectPreview(Visible=Toggle(False), AllObjects_Object=[curvepoint, item_5])
sort = SortList(Keys=pdecon_2.ZComponent, ValuesA=merge_3)  # -> Keys, ValuesA
item_4 = ListItem(List=sort.ValuesA, Index=0, Wrap=True)  # -> Item, Item1
xy = XYPlane(Origin=item_4.Item1)
xy_2 = XYPlane(Origin=item_4.Item)
twn2plns = TweenTwoPlanes(PlaneA=xy_2, PlaneB=xy, Factor=Slider(0.001, range=0.001..0.999), Quaternion=True)
Z = UnitZ(Factor=Slider(53, range=0..1000))
move = Move(Geometry=twn2plns, Motion=Z)  # -> Geometry, Transform
# Part of the toolpath can be selected and previewed. Also the continuity can be checked with the 'Point on Curve'.
pcx = CurvePlane(Curve=join, Plane=[twn2plns, move.Geometry])  # -> Points, flatten(ParamsC), ParamsP
# This graph should gradually increase and never decrease. This checks whether the nozzle will only increase in height and therefore never collide with the printed part.
split = SplitList(List=pcx.ParamsC, Index=2)  # -> ListA, ListB
shatter_2 = Shatter(Curve=join, Parameters=split.ListA)
item_5 = ListItem(List=shatter_2, Index=1, Wrap=True)
curvepoint = PointOnCurve(item_5, parameter=0)

# ---- group: Self-Intersection
# Checks whether the toolpath is self-intersecting. This may not be a problem since these issues are often very locallyand on a very small scale, but if they occur they need to be checked.
toggle = BooleanToggle(False)
onoff_2 = EnableDisableObject(Enabled=toggle, AllObjects_Object=[cx, lng_4, should_be_0])
cx = CurveSelf(Curve=join)  # -> Points, Params; disabled
lng_4 = ListLength(List=cx.Points)  # disabled
should_be_0 = Panel(lng_4)  # disabled

# ---- group: Single Toolpath
lng_5 = ListLength(List=join)
equals = Equality(FirstNumber=lng_5, SecondNumber=1)  # -> Equality, Inequality
should_be_true = Panel(equals.Equality)
