# Grasshopper definition fibo_test.gh (Grasshopper 1.0.7)

path = FilePath("fibo.py")
python = GhPythonScript(fileName=path, number=Slider(19, range=1..150))  # -> out, a
# ---------- python: Python ----------
__author__ = "maxla"
__version__ = "2021.03.16"

import rhinoscriptsyntax as rs
import sys

# Append filePath for import if necessary:
pathAppended = False
filePath = rs.WorkingFolder() + fileName
print(filePath)

import fibo
a = fibo.fib2(number)
# ---------- end python ----------
panel = Panel(python.a)
# This proves that once the entire module is loaded in the first python script using sys, it can be easily imported in other scripts using just `import`
python_2 = GhPythonScript(x=Slider(31, range=1..150))  # -> out, a
# ---------- python_2: Python ----------
__author__ = "jose.urra"
__version__ = "2021.03.24"

import rhinoscriptsyntax as rs
import fibo
a = fibo.fib2(x)
# ---------- end python_2 ----------
panel_2 = Panel(python_2.a)
