# Grasshopper definition fibo_test.gh (Grasshopper 1.0.7)

panel = Panel("D:\RSE_Work\2021-Robotic-Building-Open-Access\REPOS\Toolpath-Generator\fibo_test\fibo.py")
path = FilePath(panel)
python = GhPythonScript(filePath=path, number=Slider(32, range=1..150))  # -> out, a
# ---------- python: Python ----------
__author__ = "maxla"
__version__ = "2021.03.16"

import rhinoscriptsyntax as rs
import sys

# Append filePath for import if necessary:
pathAppended = False

for x in sys.path:
    if(x==filePath):
        pathAppended = True

if (pathAppended == False):
    sys.path.append(filePath)

for x in sys.path:
    print(x)


import fibo
#from fibo import fib

#fib2 = fibo.fib2
a = fibo.fib2(number)
# ---------- end python ----------
panel_2 = Panel(python.a)
