# Grasshopper definition Fibo test.gh (Grasshopper 1.0.7)

panel = Panel("C:\Users\maxla\OneDrive\Robotic Building Studio\ESA\Printing")
path = FilePath(panel)
python = GhPythonScript(filePath=path)  # -> out, a
# ---------- python: Python ----------
__author__ = "maxla"
__version__ = "2021.03.16"

import rhinoscriptsyntax as rs
import sys

#Append filePath for import if necessary:
pathAppended = False
for x in sys.path:
    if(x==filePath):
        pathAppended = True

if (pathAppended == False):
    sys.path.append(filePath)
for x in sys.path:
    print(x)


import fibo
#from fibo import fib

#fib2 = fibo.fib2
a = fibo.fib(2000)
# ---------- end python ----------
