# Grasshopper definition Toolpaths.gh (Grasshopper 1.0.7)
# plug-ins: ClipperComponents, Pufferfish, Shortest Walk in Gh, Kangaroo Components, Kangaroo2 Components, Anemone, EleFront, Parakeet

# ----
# Toolpath Generation
# In this script toolpaths are generated from cellular geometry with the aim of 3D printing. Single curves are created for each printing layer, which will be connected in a single polyline in a consecutive script. This will eventually result in a single continuous toolpath. In a last script this is used to generate Gcode for 3D printing.
# 
# - First refer to the to be printed geometry in the pipeline below. This should contain good meshes describing every individual cell. One cell per prospected layer may be open.
# - Provide the desired printing settings.
# - Run the script
# - Bake the polylines
# - Check according to the specifications below. The checks indicate the layers in which issues emerge. These need to be edited manually after baking, before running the following script.
# Geometry
pipeline = GeometryPipeline(
    GroupByLayer=False,
    GroupByType=False,
    IncludeHidden=True,
    IncludeLocked=True,
    LayerFilter="Prototype2::Component3::Semi-Cl.",
    NameFilter="*",
    SublayerFiltering=True,
    TypeFilter=32)

# ----
# Print Settings
layer_width_2 = Slider(11, range=0..40)
layer_height = Slider(9, range=0..20)

# ----
# Refer to Geometry
# Orient the geometry in Rhino to the XY-plane. The Z-axis will become the printing direction. If the geometry does not contain a planar side which can be placed on the printing bed, it can be split in two. One part can be printed in the designated direction, the other can be rotated 180 degrees (this can be done either by splitting the geometry or dividing the single layer toolpaths in two groups).
# Every toolpath layer can contain one open mesh. The others need to be closed.
mesh = Mesh(pipeline)
meshcap = MeshCap(Mesh=mesh)
bbox = BoundingBox(Content=mesh, Plane=PlaneXY(0, 0, 0), UnionBox=True)  # -> Box, Box_2
smesh = SimpleMesh(Brep=bbox.Box)

# ----
# Print Bed and Direction
# Describe the print bed. It is the XY-plane at the lowest point of the geometry.
demesh = DeconstructMesh(Mesh=smesh)  # -> Vertices, Faces, Colours, Normals
avr = Average(Input=demesh.Vertices)
pdecon = Deconstruct(Point=demesh.Vertices)  # -> XComponent, YComponent, ZComponent
sort = SortList(Keys=pdecon.ZComponent, ValuesA=demesh.Vertices)  # -> Keys, ValuesA
item = ListItem(List=sort.ValuesA, Index=0, Wrap=True)
xy = XYPlane(Origin=item)
project = Project(Geometry=avr, Plane=xy)  # -> Geometry, Transform
Z = UnitZ(Factor=expr("-x/2", layer_height))
xy_2 = XYPlane(Origin=project.Geometry)
move = Move(Geometry=xy_2, Motion=Z)  # -> Geometry, Transform
deplane = DeconstructPlane(Plane=move.Geometry)  # -> Origin, XAxis, YAxis, ZAxis

# ----
# Contours
contour = Contour(Shape=mesh, Point=move.Geometry, Direction=deplane.ZAxis, Distance=layer_height)  # -> simplify(Contours)
join = JoinCurves(Curves=flatten(contour), Preserve=False)

# ----
# Order in Paths
pcen = PolygonCenter(Polyline=join)  # -> CenterV, CenterE, CenterA
pdecon_2 = Deconstruct(Point=pcen.CenterV)  # -> XComponent, YComponent, ZComponent
sort_2 = SortList(Keys=pdecon_2.ZComponent, ValuesA=join)  # -> Keys, ValuesA
# Sort the curves according to elevation and order them into branches.
round = Round(Number=sort_2.Keys)  # -> Nearest, Floor, Ceiling
reldif = RelativeDifferences(Values=round.Nearest)
equals = Equality(FirstNumber=reldif, SecondNumber=0)  # -> Equality, Inequality
mindex = MemberIndex(Set=equals.Inequality, Member=True)  # -> Index, Count
ins = InsertItems(List=mindex.Index, Item=0, Indices=0, Wrap=True)
lng = ListLength(List=join)
ins_2 = InsertItems(List=ins, Item=lng, Indices=-1, Wrap=True)
reldif_2 = RelativeDifferences(Values=ins_2)
cull_i = CullIndex(List=reldif_2, Indices=0, Wrap=True)
partition = PartitionList(List=sort_2.ValuesA, Size=cull_i)  # -> simplify(Chunks)
lng_2 = ListLength(List=cull_i)  # -> expr("x-1", Length)
clscrv = CloseCurve(Curve=partition, CloseType=0, Bulge=0.5, Tolerance=expr("x*0.7", layer_width_2))  # -> simplify(Closed), R

number_slider = Slider(2, range=0..2)

# ----
# Bake
panel = Panel("ToolPaths::")
# Check
panel_2 = Panel("Toolpaths")
bake = Button()

# ----
# Run
run = BooleanToggle(True)

# ----
# Offset Curves and Connect Cells
# Offset the curves and cull the small and narrow ones.
# A diagram is generated which determines which cell edges need to be trimmed and connected to the neighbour. The diagram connects all cells to the exterior curve, without enclosing any regions. Connecting the cells assigned by the diagram will result in a single continuous curve.
# From the diagram the correct edges need to be selected. It should be ensured that the same edges from neighbouring cells are selected. To do this the most perpendicular lines from multiple lines in proximity are selected. If these are similar the longest is selected.
# Trimming regions are created from the mid-point of the selected lines. These are used to trim the curves. The resulting single curve is placed in a tree branch corresponding to the layer. Not all situations are solved in this phase.
number_slider_2 = Slider(2, range=0..180)

filter = StreamFilter(Gate=run, Stream0=number_slider_2, Stream1=lng_2)

loop_start = LoopStart(N=filter, T=Button(), D0=clscrv.Closed)  # -> port, Counter, Data, Data_2
branch = TreeBranch(Tree=simplify(loop_start.Data), Path=loop_start.Counter, MaintainPaths=True)
crv = Curve(branch)

panel_3 = Panel(loop_start.Counter)

# ---- group: Offset
polyoffset = PolylineOffset(
    Polylines=crv,
    Distance=layer_width_2,
    Plane=Plane(origin=(0, 0, 0), x=(0, 0, 0), y=(0, 0, 0)),
    Tolerance=0.0001,
    ClosedFillet=number_slider,
    OpenFillet=number_slider,
    Miter=2)  # -> Contour, Holes
crv_2 = Curve([polyoffset.Holes, polyoffset.Contour])

# ---- group: Minimum Length and Proportions
explode = Explode(Curve=crv_2, Recursive=True)  # -> Segments, Vertices
item_2 = ListItem(List=explode.Vertices, Index=0, Wrap=True)
fline = FitLine(Points=explode.Vertices)
lnpt = LinePt(Line=fline, Point=item_2)
# Offset Contours
brec = BoundingRectangle(Geometry=graft(crv_2), Plane=lnpt, Axis=0, Slide=0, Union=True)
drec = DeconstuctRectangle(Rectangle=brec)  # -> BasePlane, XInterval, YInterval
multiplication = Multiplication(A=layer_width_2, B=Slider(1.25, range=0..3))
dedomain = DeconstructDomain(Domain=drec.XInterval)  # -> Start, End
dedomain_2 = DeconstructDomain(Domain=drec.YInterval)  # -> Start, End
subtraction = Subtraction(A=dedomain.Start, B=dedomain.End)
subtraction_2 = Subtraction(A=dedomain_2.Start, B=dedomain_2.End)
abs = Absolute(Value=subtraction)
abs_2 = Absolute(Value=subtraction_2)
larger = LargerThan(FirstNumber=abs_2, SecondNumber=multiplication)  # -> LargerThan, OrEqualTo
larger_2 = LargerThan(FirstNumber=abs, SecondNumber=multiplication)  # -> LargerThan, OrEqualTo
and = GateAnd(A=larger_2.LargerThan, B=larger.LargerThan)  # -> flatten(Result)
cull = CullPattern(List=crv_2, CullPattern=and)

# ---- group: Plane Surfaces
series = Series(Start=0, Step=layer_height, Count=1)
amp = Amplitude(Vector=deplane.ZAxis, Amplitude=series)
move_2 = Move(Geometry=move.Geometry, Motion=amp)  # -> Geometry, Transform
brec_2 = BoundingRectangle(Geometry=crv, Plane=move_2.Geometry, Axis=0, Slide=0, Union=True)
area = Area(Geometry=brec_2)  # -> Area, Centroid
scale = Scale(Geometry=brec_2, Center=area.Centroid, Factor=5)  # -> Geometry, Transform
boundary = BoundarySurfaces(Edges=scale.Geometry)

# ----
clscrv_2 = CloseCurve(Curve=crv, CloseType=0, Bulge=0.5, Tolerance=layer_width_2)  # -> Closed, R

# ---- group: Dispatch Closed Cells
crv_3 = Curve(clscrv_2.Closed)
cls = Closed(Curve=crv_3)  # -> Closed, Periodic
dispatch = Dispatch(List=crv_3, DispatchPattern=cls.Closed)  # -> ListA, ListB

# ----
explode_2 = Explode(Curve=dispatch.ListA, Recursive=True)  # -> flatten(Segments), Vertices
dupln = RemoveDuplicateLines(Lines=explode_2.Segments, Tolerance=0.01)

# ---- group: Polylines
srfsplit = SurfaceSplit(Surface=boundary, Curves=cull)

# ----
area_2 = Area(Geometry=srfsplit)  # -> Area, Centroid
sort_3 = SortList(Keys=area_2.Area, ValuesA=srfsplit)  # -> Keys, reverse(ValuesA)
cull_i_2 = CullIndex(List=sort_3.ValuesA, Indices=0, Wrap=True)

# ---- group: Polylines (continued)
debrep = DeconstructBrep(Brep=cull_i_2)  # -> Faces, Edges, Vertices
lng_3 = ListLength(List=debrep.Vertices)
sort_4 = SortList(Keys=flatten(lng_3), ValuesA=cull_i_2)  # -> Keys, ValuesA
item_3 = ListItem(List=sort_4.ValuesA, Index=-1, Wrap=True)
edges = BrepEdges(Brep=item_3)  # -> Naked, Interior, NonManifold

# ----
# Closed Non-Overlapping Polylines
# Create curves which are closed, non-selfintersecting etc.
join_2 = JoinCurves(Curves=edges.Naked, Preserve=False)

# ---- group: Cull Polylines Outside
xy_3 = XYPlane(Origin=Point(0, 0, 0))
planar = Planar(Curve=branch)  # -> Planar, Plane, Deviation
flippln = FlipPlane(Plane=planar.Plane, Guide=xy_3, FlipX=False, FlipY=False, FlipZ=True)  # -> Flipped, R
avrpln = AveragePlane(Planes=flippln.Flipped)
sec = MeshPlane(Mesh=meshcap, Plane=avrpln)  # -> flatten(Curves)
trim = TrimWithRegions(Curve=join_2, Regions=sec, Plane=avrpln)  # -> flatten(Inside), Outside
len = Length(Curve=trim.Inside)
multiplication_2 = Multiplication(A=layer_width_2, B=2)
smaller = SmallerThan(FirstNumber=len, SecondNumber=multiplication_2)  # -> SmallerThan, OrEqualTo
cull_2 = CullPattern(List=trim.Inside, CullPattern=invert(smaller.SmallerThan))

# ----
crv_4 = Curve(cull_2)

# ---- group: Shortest Path
len_2 = Length(Curve=crv_4)
sort_5 = SortList(Keys=len_2, ValuesA=crv_4)  # -> Keys, reverse(ValuesA)
cull_i_3 = CullIndex(List=sort_5.ValuesA, Indices=0, Wrap=True)
item_4 = ListItem(List=sort_5.ValuesA, Index=0, Wrap=True)

# ----
pcen_2 = PolygonCenter(Polyline=cull_i_3)  # -> CenterV, CenterE, CenterA
cps = ClosestPoints(Point=pcen_2.CenterE, Cloud=pcen_2.CenterE, Count=3)  # -> ClosestPoint, CPIndex, Distance
item_5 = ListItem(List=cps.ClosestPoint, Index=1, Wrap=True)  # -> flatten(Item)
ln = Line(StartPoint=pcen_2.CenterE, EndPoint=item_5)

# ---- group: Delaunay
con = DelaunayEdges(Points=pcen_2.CenterE, Plane=PlaneXY(0, 0, 0))  # -> Connectivity, flatten(Edges)
dupln_2 = RemoveDuplicateLines(Lines=con.Edges, Tolerance=0.01)
cls_2 = Closed(Curve=cull_i_3)  # -> Closed, Periodic
dispatch_2 = Dispatch(List=pcen_2.CenterE, DispatchPattern=cls_2.Closed)  # -> ListA, ListB
cp = ClosestPoint(Point=dispatch_2.ListB, Cloud=dispatch_2.ListA)  # -> ClosestPoint, CPIndex, Distance
ln_2 = Line(StartPoint=dispatch_2.ListB, EndPoint=cp.ClosestPoint)

# ----
ccx = CurveCurve(CurveA=graft(dupln_2), CurveB=dupln)  # -> Points, ParamsA, ParamsB
trim_2 = TrimTree(Tree=simplify(ccx.Points), Depth=1)
lng_4 = ListLength(List=trim_2)
smaller_2 = SmallerThan(FirstNumber=lng_4, SecondNumber=2)  # -> SmallerThan, OrEqualTo

# ---- group: Delaunay (continued)
cull_3 = CullPattern(List=dupln_2, CullPattern=flatten(smaller_2.SmallerThan))  # -> flatten(List)
merge = Merge(Data1=cull_3, Data2=ln_2)  # -> flatten(Result)

# ---- group: Shortest Path (continued)
crv_cp = CurveClosestPoint(Point=pcen_2.CenterE, Curve=item_4)  # -> Point, Parameter, Distance
ln_3 = Line(StartPoint=pcen_2.CenterE, EndPoint=crv_cp.Point)
shortwalk = ShortestWalk(Curves=merge, WantedPath=graft(ln_3))  # -> ShortestWalk, Succession, Direction, Length

# ----
clean = CleanTree(RemoveNulls=True, RemoveInvalid=True, RemoveEmpty=False, Tree=shortwalk.ShortestWalk)

# ---- group: Connection to Main from paths
explode_3 = Explode(Curve=clean, Recursive=True)  # -> Segments, Vertices
Z_2 = UnitZ(Factor=1)
extr = Extrude(Base=explode_3.Segments, Direction=Z_2)
dupln_3 = RemoveDuplicateLines(Lines=flatten(explode_3.Segments), Tolerance=0.01)
smesh_2 = SimpleMesh(Brep=extr)  # -> flatten(Mesh)
mjoin = MeshJoin(Meshes=smesh_2)
disjoint = DisjointMesh(Mesh=mjoin)  # -> graft(Meshes)
demesh_2 = DeconstructMesh(Mesh=disjoint)  # -> Vertices, Faces, Colours, Normals
# Connection Diagram
crv_cp_2 = CurveClosestPoint(Point=demesh_2.Vertices, Curve=item_4)  # -> Point, Parameter, Distance
sort_6 = SortList(Keys=crv_cp_2.Distance, ValuesA=crv_cp_2.Point, ValuesB=demesh_2.Vertices)  # -> Keys, ValuesA, ValuesB
item_6 = ListItem(List=sort_6.ValuesA, Index=0, Wrap=True)
item_7 = ListItem(List=sort_6.ValuesB, Index=0, Wrap=True)
ln_4 = Line(StartPoint=item_7, EndPoint=item_6)  # -> flatten(Line)

# ---- group: Connection to Main from single cells
pull = PullPoint(Point=pcen_2.CenterE, Geometry=dupln_3, ClosestOnly=True)  # -> ClosestPoint, Distance
nullrep = ReplaceNulls(Items=pull.Distance, Replacements=11)  # -> Items, Count
larger_3 = LargerThan(FirstNumber=nullrep.Items, SecondNumber=1)  # -> LargerThan, OrEqualTo
cull_4 = CullPattern(List=ln_3, CullPattern=flatten(larger_3.LargerThan))

# ----
cull_5 = CullPattern(List=ln, CullPattern=flatten(larger_3.LargerThan))
ccx_2 = CurveCurve(CurveA=graft(cull_4), CurveB=dupln)  # -> simplify(Points), ParamsA, ParamsB
tstat = TreeStatistics(Tree=ccx_2.Points)  # -> Paths, Length, Count
item_8 = ListItem(List=tstat.Paths, Index=0, Wrap=True)
dpath = DeconstructPath(Branch=item_8)
lng_5 = ListLength(List=dpath)
trim_3 = TrimTree(Tree=ccx_2.Points, Depth=expr("x-1", lng_5))
lng_6 = ListLength(List=trim_3)
smaller_3 = SmallerThan(FirstNumber=lng_6, SecondNumber=2)  # -> SmallerThan, OrEqualTo
p_n_c = PickNChoose(Pattern=smaller_3.SmallerThan, Stream0=graft(cull_5), Stream1=graft(cull_4))

# ---- group: Initial Connection Diagram
merge_2 = Merge(Data1=ln_4, Data2=p_n_c)
dupln_4 = RemoveDuplicateLines(Lines=flatten(merge_2), Tolerance=0.01)
ext = ExtendCurve(Curve=dupln_4, Type=0, Start=5, End=5)
redpline = Reduce(Polyline=ext, Tolerance=1)  # -> Polyline, Reduction
merge_3 = Merge(Data1=dupln_3, Data3=redpline.Polyline)  # -> flatten(Result)

# ---- group: Avoid Closed Loops
boundary_2 = BoundarySurfaces(Edges=item_4)
srfsplit_2 = SurfaceSplit(Surface=boundary_2, Curves=merge_3)
area_3 = Area(Geometry=srfsplit_2)  # -> Area, Centroid
lng_7 = ListLength(List=srfsplit_2)  # -> expr("x-1", Length)
sort_7 = SortList(Keys=area_3.Area, ValuesA=area_3.Centroid)  # -> Keys, ValuesA
split = SplitList(List=sort_7.ValuesA, Index=lng_7)  # -> graft(ListA), ListB
lng_8 = ListLength(List=merge_3)
crv_cp_3 = CurveClosestPoint(Point=split.ListA, Curve=merge_3)  # -> Point, Parameter, Distance
series_2 = Series(Start=0, Step=1, Count=lng_8)
sort_8 = SortList(Keys=crv_cp_3.Distance, ValuesA=series_2)  # -> Keys, ValuesA
item_9 = ListItem(List=sort_8.ValuesA, Index=0, Wrap=True)  # -> flatten(Item)
cset = CreateSet(List=item_9)  # -> Set, Map
cull_i_4 = CullIndex(List=merge_3, Indices=cset.Set, Wrap=True)

# ----
clean_2 = CleanTree(RemoveNulls=True, RemoveInvalid=True, RemoveEmpty=False, Tree=cull_i_4)

# ---- group: Refer to closed Voronoi Cells
explode_4 = Explode(Curve=clean_2, Recursive=True)  # -> Segments, Vertices
incurves = PointInCurves(Point=explode_4.Vertices, Curves=dispatch.ListA)  # -> Relationship, graft(Index), Point
item_10 = ListItem(List=dispatch.ListA, Index=incurves.Index, Wrap=True)
number_slider_3 = Slider(1, range=0..30)
lng_9 = ListLength(List=explode_4.Vertices)
dup = DuplicateData(Data=explode_4.Segments, Number=lng_9, Order=True)  # -> graft(Data)

# ----
# Select Connecting Edges
boundary_3 = BoundarySurfaces(Edges=item_10)
edges_2 = BrepEdges(Brep=boundary_3)  # -> Naked, Interior, NonManifold
join_3 = JoinCurves(Curves=edges_2.Naked, Preserve=False)

# ---- group: Refer to closed Voronoi Cells (continued)
explode_5 = Explode(Curve=join_3, Recursive=True)  # -> Segments, Vertices
ext_2 = ExtendCurve(Curve=explode_5.Segments, Type=0, Start=number_slider_3, End=number_slider_3)  # -> simplify(Curve)
lng_10 = ListLength(List=ext_2)
dup_2 = DuplicateData(Data=dup, Number=lng_10, Order=True)  # -> graft(Data)

# ---- group: Diagram
simplify = SimplifyTree(Tree=dup_2, Front=False)

# ---- group: Voronoi Cells
simplify_2 = SimplifyTree(Tree=graft(explode_5.Segments), Front=False)

# ---- group: Extended Voronoi Cells
simplify_3 = SimplifyTree(Tree=graft(ext_2), Front=False)

# ----
ccx_3 = CurveCurve(CurveA=simplify, CurveB=simplify_3)  # -> Points, ParamsA, ParamsB

# ---- group: Select most orthogonal Edges
eval = EvaluateCurve(Curve=graft(simplify_3), Parameter=ccx_3.ParamsB)  # -> Point, simplify(Tangent), Angle
eval_2 = EvaluateCurve(Curve=simplify, Parameter=ccx_3.ParamsA)  # -> Point, Tangent, Angle
trim_4 = TrimTree(Tree=simplify(eval.Tangent), Depth=1)
trim_5 = TrimTree(Tree=simplify(eval_2.Tangent), Depth=1)
vrot = Rotate(Vector=trim_4, Axis=Z_2, Angle=1.570796327)
neg = Negative(Value=vrot)
angle = Angle(VectorA=trim_5, VectorB=vrot)  # -> Angle, Reflex
angle_2 = Angle(VectorA=trim_5, VectorB=neg)  # -> Angle, Reflex

# ---- group: Select intersected Voronoi Edges
lng_11 = ListLength(List=eval.Point)
equals_2 = Equality(FirstNumber=lng_11, SecondNumber=1)  # -> Equality, Inequality
cull_6 = CullPattern(List=simplify_2, CullPattern=equals_2.Equality)
trim_6 = TrimTree(Tree=simplify(cull_6), Depth=1)

# ----
min = Minimum(A=angle.Angle, B=angle_2.Angle)

# ---- group: Select most orthogonal Edges (continued)
lng_12 = ListLength(List=min)
series_3 = Series(Start=0, Step=1, Count=lng_12)
sort_9 = SortList(Keys=min, ValuesA=series_3)  # -> Keys, ValuesA
item_11 = ListItem(List=sort_9.Keys, Index=0, Wrap=True)
similar = Similarity(FirstNumber=sort_9.Keys, SecondNumber=item_11, Threshold=0.1)  # -> Similarity, AbsoluteDifference
cull_7 = CullPattern(List=sort_9.ValuesA, CullPattern=similar.Similarity)
item_12 = ListItem(List=trim_6, Index=cull_7, Wrap=True)

# ---- group: Select Longest Edge
len_3 = Length(Curve=item_12)
sort_10 = SortList(Keys=len_3, ValuesA=item_12)  # -> Keys, reverse(ValuesA)
equals_3 = Equality(FirstNumber=lng_12, SecondNumber=0)  # -> Equality, Inequality
item_13 = ListItem(List=sort_10.ValuesA, Index=0, Wrap=True)
cull_8 = CullPattern(List=item_13, CullPattern=equals_3.Inequality)  # -> simplify(List)

# ----
suirify = Suirify(cull_8)
tstat_2 = TreeStatistics(Tree=suirify)  # -> Paths, Length, Count
item_14 = ListItem(List=tstat_2.Paths, Index=0, Wrap=True)
dpath_2 = DeconstructPath(Branch=item_14)
lng_13 = ListLength(List=dpath_2)

trim_7 = TrimTree(Tree=simplify(suirify), Depth=expr("x-1", lng_13))

dupln_5 = RemoveDuplicateLines(Lines=trim_7, Tolerance=0.1)

item_15 = ListItem(List=dupln_5, Index=0, Wrap=True)  # -> flatten(Item)
clean_3 = CleanTree(RemoveNulls=True, RemoveInvalid=True, RemoveEmpty=False, Tree=item_15)

ext_3 = ExtendCurve(Curve=clean_3, Type=0, Start=number_slider_3, End=number_slider_3)  # -> simplify(Curve)

# ---- group: Trim Regions
ccx_4 = CurveCurve(CurveA=graft(ext_3), CurveB=graft(clean_2))  # -> flatten(Points), ParamsA, ParamsB
dom = ConstructDomain(DomainStart=expr("-x*3", layer_width_2), DomainEnd=expr("x*3", layer_width_2))
dom_2 = ConstructDomain(DomainStart=expr("-x", layer_width_2), DomainEnd=layer_width_2)
equals_4 = Equality(FirstNumber=lng_13, SecondNumber=1)  # -> Equality, Inequality

# ----
# Continuous Toolpath
eval_3 = EvaluateCurve(Curve=reparameterize(ext_3), Parameter=0.5)  # -> Point, Tangent, Angle
Z_3 = UnitZ(Factor=1)
dom_3 = ConstructDomain(DomainStart=expr("-x*2", layer_width_2), DomainEnd=expr("x*2", layer_width_2))
dom_4 = ConstructDomain(DomainStart=expr("-x", layer_width_2), DomainEnd=layer_width_2)

vec2pt = Vector2Pt(PointA=ccx_4.Points, PointB=eval_3.Point, Unitize=False)  # -> Vector, Length
min_2 = Minimum(A=layer_width_2, B=vec2pt.Length)
amp_2 = Amplitude(Vector=vec2pt.Vector, Amplitude=expr("0.4*x", min_2))
move_3 = Move(Geometry=ccx_4.Points, Motion=amp_2)  # -> Geometry, Transform

pl = PlaneNormal(Origin=move_3.Geometry, ZAxis=Z_3)
deplane_2 = DeconstructPlane(Plane=pl)  # -> Origin, XAxis, YAxis, ZAxis
angle_3 = Angle(VectorA=deplane_2.XAxis, VectorB=eval_3.Tangent, Plane=pl)  # -> Angle, Reflex
prot = RotatePlane(Plane=pl, Angle=angle_3.Angle)
rectangle = Rectangle(Plane=prot, XSize=dom_4, YSize=dom_3, Radius=layer_width_2)  # -> flatten(Rectangle), Length

# ---- group: Trim Regions (continued)
rectangle_2 = Rectangle(Plane=prot, XSize=dom_2, YSize=dom, Radius=layer_width_2)  # -> flatten(Rectangle), Length
ccx_5 = CurveCurve(CurveA=graft(rectangle.Rectangle), CurveB=crv_4)  # -> Points, ParamsA, ParamsB
trim_8 = TrimTree(Tree=simplify(ccx_5.Points), Depth=expr("x-1", lng_13))
flatten = FlattenTree(Tree=ccx_5.Points, Path="{0}")
filter_2 = StreamFilter(Gate=equals_4.Equality, Stream0=trim_8, Stream1=flatten)
lng_14 = ListLength(List=filter_2)
larger_4 = LargerThan(FirstNumber=lng_14, SecondNumber=2)  # -> LargerThan, OrEqualTo
p_n_c_2 = PickNChoose(Pattern=flatten(larger_4.LargerThan), Stream0=rectangle_2.Rectangle, Stream1=rectangle.Rectangle)
runion = RegionUnion(Curves=p_n_c_2)

# ---- group: Trim
trim_9 = TrimWithRegions(Curve=crv_4, Regions=runion)  # -> Inside, Outside
extr_2 = Extrude(Base=item_3, Direction=deplane.ZAxis)
move_4 = Move(Geometry=extr_2, Motion=expr("-x/2", deplane.ZAxis))  # -> Geometry, Transform
trim_10 = TrimWithBrep(Curve=runion, Brep=move_4.Geometry)  # -> Inside, Outside
end = EndPoints(Curve=trim_10.Inside)  # -> Start, End
pull_2 = PullPoint(Point=end.Start, Geometry=join_2, ClosestOnly=True)  # -> ClosestPoint, Distance
pull_3 = PullPoint(Point=end.End, Geometry=join_2, ClosestOnly=True)  # -> ClosestPoint, Distance
smaller_4 = SmallerThan(FirstNumber=pull_2.Distance, SecondNumber=0.1)  # -> SmallerThan, OrEqualTo
smaller_5 = SmallerThan(FirstNumber=pull_3.Distance, SecondNumber=0.1)  # -> SmallerThan, OrEqualTo
cull_9 = CullPattern(List=end.Start, CullPattern=smaller_4.SmallerThan)
cull_10 = CullPattern(List=end.End, CullPattern=smaller_5.SmallerThan)
ln_5 = Line(StartPoint=cull_9, EndPoint=cull_10)
join_4 = JoinCurves(Curves=ln_5, Preserve=False)
len_4 = Length(Curve=join_4)
sort_11 = SortList(Keys=len_4, ValuesA=join_4)  # -> Keys, reverse(ValuesA)
merge_4 = Merge(Data1=simplify(trim_9.Outside), Data2=simplify(sort_11.ValuesA))
join_5 = JoinCurves(Curves=flatten(merge_4), Preserve=False)

# ---- group: Single Closed Offset
crv_5 = Curve(crv_4)
lng_15 = ListLength(List=crv_5)
equals_5 = Equality(FirstNumber=lng_15, SecondNumber=1)  # -> Equality, Inequality
filter_3 = StreamFilter(Gate=equals_5.Equality, Stream0=join_5, Stream1=crv_5)

# ---- group: Interior Vertices
merge_5 = Merge(Data1=end.Start, Data2=end.End)  # -> flatten(Result)
explode_6 = Explode(Curve=filter_3, Recursive=True)  # -> Segments, Vertices
incurves_2 = PointInCurves(Point=explode_6.Vertices, Curves=sec)  # -> Relationship, Index, Point
cp_2 = ClosestPoint(Point=explode_6.Vertices, Cloud=merge_5)  # -> ClosestPoint, CPIndex, Distance
equals_6 = Equality(FirstNumber=cp_2.Distance, SecondNumber=0)  # -> Equality, Inequality
equals_7 = Equality(FirstNumber=incurves_2.Relationship, SecondNumber=2)  # -> Equality, Inequality
or = GateOr(A=equals_7.Equality, B=equals_6.Equality)
cull_11 = CullPattern(List=explode_6.Vertices, CullPattern=or)
pline = PolyLine(Vertices=cull_11, Closed=False)  # -> flatten(Polyline)

# ---- group: Assign Data Tree Path
tstat_3 = TreeStatistics(Tree=pline)  # -> Paths, Length, Count
path = ConstructPath(Indices=loop_start.Counter)
replace = ReplacePaths(Data=pline, Search=tstat_3.Paths, Replace=path)

# ----
merge_6 = Merge(Data1=simplify(loop_start.Data_2), Data2=simplify(replace))
clean_4 = CleanTree(RemoveNulls=True, RemoveInvalid=True, RemoveEmpty=False, Tree=merge_6)
loop_end = LoopEnd(
    port=loop_start.port,
    Exit=False,
    Data=simplify(loop_start.Data),
    Data_2=clean_4,
    TimeOutVal=0,
    pausedState=False,
    state="Output last")  # -> D0, D1

# ----
# Close and Cull too Short
clean_5 = CleanTree(RemoveNulls=True, RemoveInvalid=True, RemoveEmpty=True, Tree=loop_end.D1)
num = Number(layer_width_2)
clscrv_3 = CloseCurve(Curve=clean_5, CloseType=0, Bulge=0.5, Tolerance=expr("x*0.7", num))  # -> Closed, R
len_5 = Length(Curve=clscrv_3.Closed)
smaller_6 = SmallerThan(FirstNumber=len_5, SecondNumber=expr("x*3", num))  # -> SmallerThan, OrEqualTo
cull_12 = CullPattern(List=clscrv_3.Closed, CullPattern=invert(smaller_6.SmallerThan))

# ---- group: Closed
cls_3 = Closed(Curve=cull_12)  # -> Closed, Periodic
clean_6 = CleanTree(RemoveNulls=True, RemoveInvalid=True, RemoveEmpty=False, Tree=cull_12)
clean_7 = CleanTree(RemoveNulls=True, RemoveInvalid=True, RemoveEmpty=False, Tree=flatten(cls_3.Closed))
not = GateNot(A=clean_7)
ma = MassAddition(Input=not)  # -> Result, PartialResults
cull_13 = CullPattern(List=clean_6, CullPattern=invert(cls_3.Closed))  # -> simplify(List)
should_be_0 = Panel(ma.Result)
lng_16 = ListLength(List=cull_13)
equals_8 = Equality(FirstNumber=lng_16, SecondNumber=0)  # -> Equality, Inequality
tstat_4 = TreeStatistics(Tree=cull_13)  # -> Paths, Length, Count
cull_14 = CullPattern(List=graft(tstat_4.Paths), CullPattern=equals_8.Inequality)  # -> flatten(List)
check_in_which_layers_the_issues_occur = Panel(cull_14)

# ---- group: Continuous
lng_17 = ListLength(List=cull_12)
equals_9 = Equality(FirstNumber=lng_17, SecondNumber=1)  # -> Equality, Inequality
not_2 = GateNot(A=flatten(equals_9.Equality))
tstat_5 = TreeStatistics(Tree=lng_17)  # -> Paths, Length, Count
ma_2 = MassAddition(Input=not_2)  # -> Result, PartialResults
cull_15 = CullPattern(List=graft(tstat_5.Paths), CullPattern=equals_9.Inequality)  # -> flatten(List)
should_be_0_2 = Panel(ma_2.Result)
check_in_which_layers_the_issues_occur_2 = Panel(cull_15)

# ---- group: Self-Intersection
# There are some issues here. The self-intersections are on a scale on which it is neglectible for the printing, but it should be checked in the script where these issues emerge.
cx = CurveSelf(Curve=cull_12)  # -> Points, Params
lng_18 = ListLength(List=cx.Points)
equals_10 = Equality(FirstNumber=lng_18, SecondNumber=0)  # -> Equality, Inequality
tstat_6 = TreeStatistics(Tree=cx.Params)  # -> Paths, Length, Count
cull_16 = CullPattern(List=graft(tstat_6.Paths), CullPattern=equals_10.Inequality)  # -> flatten(List)
check_in_which_layers_the_issues_occur_3 = Panel(cull_16)

# ---- group: Single Curve
# Check whether the toolpaths are closed and continuous within the layer. If a few issues occur, they need to be edited manually in Rhino. It can happen that the last layer (mainly when the contour cuts the geometry only partially) is problematic. When the aim is prototyping, it might not be a problem to leave out the last layer. This needs to be considered for every case individually.
lng_19 = ListLength(List=clean_6)
larger_5 = LargerThan(FirstNumber=lng_19, SecondNumber=1)  # -> LargerThan, OrEqualTo
tstat_7 = TreeStatistics(Tree=clean_6)  # -> Paths, Length, Count
cull_17 = CullPattern(List=tstat_7.Paths, CullPattern=flatten(larger_5.LargerThan))
panel_4 = Panel(cull_17)

# ----
tstat_8 = TreeStatistics(Tree=cull_12)  # -> Paths, Length, Count
dpath_3 = DeconstructPath(Branch=tstat_8.Paths)  # -> flatten(Indices)
concat = Concatenate(FragmentA=panel, FragmentB="Layer ", FragmentC=dpath_3)
attributes = DefineObjectAttributes(Layer=concat, Color=ColourSwatch(SwatchColor=RGB(224, 224, 224)))
bake_2 = BakeObjects(Geometry=cull_12, Attributes=graft(attributes), BakeName=panel_2, Bake=bake)
