# Grasshopper definition continuous_toolpaths.gh (Grasshopper 1.0.7)
# plug-ins: MetaHopper, Pufferfish, EleFront, Kangaroo2 Components, Kangaroo Components

# ----
# Continuous Toolpath
# In this tutorial toolpaths of different layers are connected to one single continuous toolpath. Ensure that the provided initial curves are closed and in layers ordered relating to the printing layers. Every layer should contain one single closed curve.
# Refer to Geometry
pipeline = GeometryPipeline(
    GroupByLayer=True,
    GroupByType=False,
    IncludeHidden=True,
    IncludeLocked=True,
    LayerFilter="ToolPaths::*",
    NameFilter="*",
    SublayerFiltering=True,
    TypeFilter=4)

# ---- group: Ensure polyline
cls = Closed(Curve=pipeline)  # -> Closed, Periodic
explode = Explode(Curve=pipeline, Recursive=True)  # -> Segments, Vertices
pline = PolyLine(Vertices=explode.Vertices, Closed=cls.Closed)

# ----
# Final single curve Check
lng = ListLength(List=pline)
larger = LargerThan(FirstNumber=lng, SecondNumber=1)  # -> LargerThan, OrEqualTo
tstat = TreeStatistics(Tree=lng)  # -> Paths, Length, Count
cull = CullPattern(List=tstat.Paths, CullPattern=flatten(larger.LargerThan))
item = ListItem(List=cull, Index=0, Wrap=True)
branch = TreeBranch(Tree=pline, Path=item, MaintainPaths=True)

item_2 = ListItem(List=flatten(pline), Index=0, Wrap=True)
flip = FlipCurve(Curve=pline, Guide=item_2)  # -> Curve, Flag

# ----
# Reduce Polyline
# Reduce the amount of vertices in the polylines within a certain tolerance. Adjust this tolerance according to the layer width. Check manually whether the tolerance doesn't result in a reduction of detail.
number_slider = Slider(1, range=0..1)
redpline = Reduce(Polyline=flip.Curve, Tolerance=number_slider)  # -> flatten(Polyline), Reduction

# ----
# Print Settings
layer_height = Slider(9, range=0..140)
layer_width = Slider(11, range=0..40)

# ----
# Fillet
explode_2 = Explode(Curve=redpline.Polyline, Recursive=True)  # -> Segments, Vertices
shift = ShiftList(List=explode_2.Segments, Shift=1, Wrap=True)
eval = EvaluateCurve(Curve=reparameterize(shift), Parameter=0.5)  # -> Point, expr("-x", Tangent), Angle
cls_2 = Closed(Curve=graft(redpline.Polyline))  # -> Closed, Periodic
eval_2 = EvaluateCurve(Curve=reparameterize(explode_2.Segments), Parameter=0.5)  # -> Point, Tangent, Angle
angle = Angle(VectorA=eval_2.Tangent, VectorB=eval.Tangent)  # -> Angle, Reflex
cull_i = CullIndex(List=angle.Angle, Indices=-1, Wrap=True)
weave = Weave(Pattern=cls_2.Closed, Stream0=cull_i, Stream1=angle.Angle, NullGaps=False)
pi = Pi(Factor=Slider(0.3, range=0..0.3))
smaller = SmallerThan(FirstNumber=weave, SecondNumber=pi)  # -> SmallerThan, OrEqualTo
mindex = MemberIndex(Set=smaller.SmallerThan, Member=True)  # -> Index, Count
item_3 = ListItem(List=angle.Angle, Index=mindex.Index, Wrap=True)  # -> Item, Item1
item_4 = ListItem(List=explode_2.Segments, Index=mindex.Index, Wrap=True)  # -> Item, Item1
expression = Expression(x=Slider(5, range=0..30), y=item_3.Item, Expression="x/sin(y/2)")
len = Length(Curve=item_4.Item)
len_2 = Length(Curve=item_4.Item1)
item_5 = ListItem(List=eval_2.Tangent, Index=mindex.Index, Wrap=True)  # -> graft(Item), graft(Item1)
item_6 = ListItem(List=explode_2.Vertices, Index=mindex.Index, Wrap=True)  # -> Item, graft(Item1), Item2
min = Minimum(A=len_2, B=expression)  # -> graft(Result)
min_2 = Minimum(A=len, B=expression)  # -> graft(Result)
neg = Negative(Value=item_5.Item)
amp = Amplitude(Vector=[neg, item_5.Item1], Amplitude=[min_2, min])
lng_2 = ListLength(List=mindex.Index)
move = Move(Geometry=item_6.Item1, Motion=amp)  # -> Geometry, Transform
equals = Equality(FirstNumber=lng_2, SecondNumber=0)  # -> Equality, Inequality
group = Group(Objects=move.Geometry)
trim = TrimTree(Tree=simplify(group), Depth=1)
replace = ReplaceItems(List=explode_2.Vertices, Item=trim, Indices=expr("x+1", mindex.Index), Wrap=False)  # -> simplify(List)
ungroup = Ungroup(Group=replace)
trim_2 = TrimTree(Tree=simplify(ungroup), Depth=1)
duppt = RemoveDuplicatePts(Points=trim_2, Tolerance=0.01)
pline_2 = PolyLine(Vertices=duppt, Closed=cls_2.Closed)  # -> flatten(Polyline)

# ----
# Select and Preview
number_slider_2 = Slider(44, range=0..130)
addition = Addition(A=number_slider_2, B=Slider(1, range=0..10))
dom = ConstructDomain(DomainStart=number_slider_2, DomainEnd=addition)
subset = SubList(Domain=dom, Wrap=True)  # -> List, Index

# ----
# Curve Direction
cls_3 = Closed(Curve=pline_2)  # -> Closed, Periodic
panel = Panel("""True
False""")
lng_3 = ListLength(List=pline_2)
reldif = RelativeDifferences(Values=cls_3.Closed)
abs = Absolute(Value=reldif)
dup = DuplicateData(Data=panel, Number=lng_3, Order=True)
mindex_2 = MemberIndex(Set=abs, Member=1)  # -> Index, Count
split = SplitList(List=dup, Index=lng_3)  # -> ListA, ListB
ins = InsertItems(List=mindex_2.Index, Item=[Slider(0, range=0..100), lng_3], Indices=[0, -1], Wrap=True)
reldif_2 = RelativeDifferences(Values=ins)
cull_i_2 = CullIndex(List=reldif_2, Indices=0, Wrap=True)
partition = PartitionList(List=split.ListA, Size=cull_i_2)
partition_2 = PartitionList(List=pline_2, Size=cull_i_2)
partition_3 = PartitionList(List=cls_3.Closed, Size=cull_i_2)
not = GateNot(A=partition_3)
flip_2 = FlipCurve(Curve=partition_2)  # -> Curve, Flag
and = GateAnd(A=not, B=partition)
p_n_c = PickNChoose(Pattern=and, Stream0=partition_2, Stream1=flip_2.Curve)

# ---- group: Closed/Open
tstat_2 = TreeStatistics(Tree=simplify(partition_3))  # -> Paths, Length, Count
item_7 = ListItem(List=partition_3, Index=0, Wrap=True)
cull_2 = CullPattern(List=tstat_2.Paths, CullPattern=flatten(item_7))
split_2 = SplitTree(Data=simplify(p_n_c), Masks=flatten(cull_2))  # -> Positive, Negative

# ---- group: Next/Prev open
tstat_3 = TreeStatistics(Tree=split_2.Positive)  # -> Paths, Length, Count
dpath = DeconstructPath(Branch=tstat_3.Paths)
addition_2 = Addition(A=dpath, B=1)
subtraction = Subtraction(A=dpath, B=1)
merge = Merge(Data1=subtraction, Data2=addition_2)
smaller_2 = SmallerThan(FirstNumber=merge, SecondNumber=0)  # -> SmallerThan, OrEqualTo
larger_2 = LargerThan(FirstNumber=merge, SecondNumber=tstat_2.Count)  # -> LargerThan, OrEqualTo
or = GateOr(A=smaller_2.SmallerThan, B=larger_2.OrEqualTo)
cull_3 = CullPattern(List=merge, CullPattern=invert(or))
path = ConstructPath(Indices=graft(cull_3))
trim_3 = TrimTree(Tree=simplify(path), Depth=1)

# ---- group: Connect open
lng_4 = ListLength(List=cull_3)
lng_5 = ListLength(List=flatten(lng_4))
panel_2 = Panel("""-1
0""")
dup_2 = DuplicateData(Data=graft(tstat_3.Paths), Number=lng_4, Order=True)
dup_3 = DuplicateData(Data=False, Number=lng_5, Order=True)
split_3 = SplitList(List=panel_2, Index=lng_4)  # -> ListA, ListB
replace_2 = ReplaceItems(List=dup_3, Item=True, Indices=0, Wrap=False)  # -> graft(List)
weave_2 = Weave(Pattern=replace_2, Stream0=split_3.ListA, Stream1=split_3.ListB, NullGaps=False)
# Adjust Seams
item_8 = TreeItem(Tree=split_2.Negative, Path=trim_3, Index=weave_2, Wrap=True)  # -> simplify(graft(Element))
tstat_4 = TreeStatistics(Tree=lng_4)  # -> Paths, Length, Count
tstat_5 = TreeStatistics(Tree=item_8)  # -> Paths, Length, Count
replace_3 = ReplacePaths(Data=item_8, Search=tstat_5.Paths, Replace=flatten(dup_2))
replace_4 = ReplacePaths(Data=lng_4, Search=tstat_4.Paths, Replace=flatten(tstat_3.Paths))
number_slider_3 = Slider(2000, range=0..10000)
end = EndPoints(Curve=replace_3)  # -> Start, End
equals_2 = Equality(FirstNumber=replace_4, SecondNumber=1)  # -> Equality, Inequality
cull_4 = CullPattern(List=end.End, CullPattern=equals_2.Equality)
Z = UnitZ(Factor=number_slider_3)
line = LineSDL(Start=cull_4, Direction=Vector(0, 0, 1), Length=number_slider_3)
shift_2 = ShiftList(List=end.End, Shift=1, Wrap=True)
ln = Line(StartPoint=end.End, EndPoint=shift_2)
move_2 = Move(Geometry=line, Motion=expr("-x/2", Z))  # -> Geometry, Transform
dupln = RemoveDuplicateLines(Lines=ln, Tolerance=0.01)
weave_3 = Weave(Pattern=equals_2.Equality, Stream0=dupln, Stream1=move_2.Geometry, NullGaps=False)

# ---- group: Adjust Seams
planar = Planar(Curve=split_2.Positive)  # -> Planar, Plane, Deviation
pcx = CurvePlane(Curve=weave_3, Plane=planar.Plane)  # -> Points, ParamsC, ParamsP
trim_4 = TrimTree(Tree=simplify(pcx.Points), Depth=1)
crv_cp = CurveClosestPoint(Point=trim_4, Curve=split_2.Positive)  # -> Point, Parameter, Distance
seam = Seam(Curve=split_2.Positive, Seam=crv_cp.Parameter)

# ---- group: Trim End
layer_width_2 = Slider(6, range=0..10)
len_3 = Length(Curve=seam)
expression_2 = Expression(x=len_3, y=layer_width_2, Expression="1-(2*y/x)")
lng_6 = ListLength(List=expression_2)
dup_4 = DuplicateData(Data=0, Number=lng_6, Order=True)
merge_2 = Merge(Data1=simplify(graft(dup_4)), Data2=simplify(graft(expression_2)))
shatter = Shatter(Curve=reparameterize(simplify(graft(seam))), Parameters=merge_2)
item_9 = ListItem(List=shatter, Index=Slider(0, range=0..1), Wrap=True)

# ----
# Continuous Curve
# The curves are trimmed at the end with the size of the layer width. A line is then generated from the end of the curve to the start of the curve in the next layer. The curves and lines are joined in a single continuous curve.
trim_5 = TrimTree(Tree=simplify(item_9), Depth=1)

crv = Curve(split_2.Negative)
end_2 = EndPoints(Curve=crv)  # -> Start, End
shift_3 = ShiftList(List=end_2.End, Shift=1, Wrap=True)
ln_2 = Line(StartPoint=end_2.Start, EndPoint=shift_3)
cull_i_3 = CullIndex(List=ln_2, Indices=-1, Wrap=True)
merge_3 = Merge(Data1=simplify(crv), Data2=simplify(cull_i_3))
join = JoinCurves(Curves=merge_3, Preserve=False)

# ---- group: Connect and Join
end_3 = EndPoints(Curve=trim_5)  # -> Start, End
shift_4 = ShiftList(List=end_3.Start, Shift=1, Wrap=True)
ln_3 = Line(StartPoint=end_3.End, EndPoint=shift_4)
cull_i_4 = CullIndex(List=ln_3, Indices=-1, Wrap=True)
merge_4 = Merge(Data1=simplify(trim_5), Data2=simplify(cull_i_4))
join_2 = JoinCurves(Curves=merge_4, Preserve=False)

# ---- group: Direction
merge_5 = Merge(Data1=simplify(join_2), Data2=simplify(join))  # -> flatten(Result)
end_4 = EndPoints(Curve=merge_5)  # -> Start, End
pdecon = Deconstruct(Point=end_4.Start)  # -> XComponent, YComponent, ZComponent
pdecon_2 = Deconstruct(Point=end_4.End)  # -> XComponent, YComponent, ZComponent
larger_3 = LargerThan(FirstNumber=pdecon.ZComponent, SecondNumber=pdecon_2.ZComponent)  # -> LargerThan, OrEqualTo
flip_3 = FlipCurve(Curve=merge_5)  # -> Curve, Flag
p_n_c_2 = PickNChoose(Pattern=larger_3.LargerThan, Stream0=merge_5, Stream1=flip_3.Curve)

# ---- group: Connect
end_5 = EndPoints(Curve=p_n_c_2)  # -> Start, End
shift_5 = ShiftList(List=end_5.Start, Shift=1, Wrap=True)
ln_4 = Line(StartPoint=shift_5, EndPoint=end_5.End)
cull_i_5 = CullIndex(List=ln_4, Indices=-1, Wrap=True)
merge_6 = Merge(Data1=p_n_c_2, Data2=cull_i_5)  # -> flatten(Result)
join_3 = JoinCurves(Curves=merge_6, Preserve=False)

# ----
# Bake
tstat_6 = TreeStatistics(Tree=join_3)  # -> Paths, Length, Count
dpath_2 = DeconstructPath(Branch=tstat_6.Paths)  # -> flatten(Indices)
concat = Concatenate(FragmentA="Continuous Toolpath", FragmentC=dpath_2)
bake = Button()
attributes = DefineObjectAttributes(Layer=concat, Color=ColourSwatch(SwatchColor=RGB(224, 224, 224)))
# Check
# Several ways to check and preview the toolpath are provided here. When issues occur, it is probably the most efficient to solve them manually after baking.
bake_2 = BakeObjects(Geometry=join_3, Attributes=graft(attributes), BakeName="Continuous Toolpath", Bake=bake)

# ---- group: Preview Part
end_6 = EndPoints(Curve=join_3)  # -> Start, End
merge_7 = Merge(Data1=end_6.Start, Data2=end_6.End)
pdecon_3 = Deconstruct(Point=merge_7)  # -> XComponent, YComponent, ZComponent
hideshow = HideShowObjectPreview(Visible=Toggle(True), AllObjects_Object=[curvepoint, item_11])
sort = SortList(Keys=pdecon_3.ZComponent, ValuesA=merge_7)  # -> Keys, ValuesA
item_10 = ListItem(List=sort.ValuesA, Index=0, Wrap=True)  # -> Item, Item1
xy = XYPlane(Origin=item_10.Item1)
xy_2 = XYPlane(Origin=item_10.Item)
twn2plns = TweenTwoPlanes(PlaneA=xy_2, PlaneB=xy, Factor=Slider(0.425, range=0.001..0.999), Quaternion=True)
Z_2 = UnitZ(Factor=Slider(53, range=0..1000))
move_3 = Move(Geometry=twn2plns, Motion=Z_2)  # -> Geometry, Transform
pcx_2 = CurvePlane(Curve=join_3, Plane=[twn2plns, move_3.Geometry])  # -> Points, flatten(ParamsC), ParamsP
# Part of the toolpath can be selected and previewed. Also the continuity can be checked with the 'Point on Curve'.
# This graph should gradually increase and never decrease. This checks whether the nozzle will only increase in height and therefore never collide with the printed part.
split_4 = SplitList(List=pcx_2.ParamsC, Index=2)  # -> ListA, ListB
shatter_2 = Shatter(Curve=join_3, Parameters=split_4.ListA)
item_11 = ListItem(List=shatter_2, Index=1, Wrap=True)
curvepoint = PointOnCurve(item_11, parameter=0.048)

# ---- group: Single Toolpath
lng_7 = ListLength(List=join_3)
equals_3 = Equality(FirstNumber=lng_7, SecondNumber=1)  # -> Equality, Inequality
should_be_true = Panel(equals_3.Equality)

# ---- group: Z-Continuity
explode_3 = Explode(Curve=join_3, Recursive=True)  # -> Segments, Vertices
pdecon_4 = Deconstruct(Point=explode_3.Vertices)  # -> XComponent, YComponent, ZComponent
should_gradually_increase = QuickGraph(pdecon_4.ZComponent, SortOrder=0)
onoff = EnableDisableObject(Enabled=Toggle(True), AllObjects_Object=[explode_3, pdecon_4, should_gradually_increase])

# ---- group: Self-Intersection
# Checks whether the toolpath is self-intersecting. This may not be a problem since these issues are often very locallyand on a very small scale, but if they occur they need to be checked.
toggle = BooleanToggle(True)
onoff_2 = EnableDisableObject(Enabled=toggle, AllObjects_Object=[cx, lng_8, should_be_0])
cx = CurveSelf(Curve=join_3)  # -> Points, Params
lng_8 = ListLength(List=cx.Points)
should_be_0 = Panel(lng_8)
