# Grasshopper definition gcode_generator.gh (Grasshopper 1.0.7)

# ----
# Generate Gcode
test_amount_of_lines = Slider(200, range=0..1000)

# ----
# Print settings
bed_temperature = Slider(60, range=0..1000)
flow = Slider(1, range=0.9..1.1)
temperature = Slider(205, range=0..1000)

# ----
# Specify Printer
list = ValueList({"Creality CR-X": 0, "Staubli 3DRobotPrinting": 1}, selected="Creality CR-X")

# ----
# Generate Gcode
# This script generates a Gcode from the single continuous toolpath created in 'Toolpath.gh' and 'continuous_toolpaths.gh'.
# 
# - Specifiy the printer
# - Provide the desired print settings
# - Generate the (test or full) Gcode
list_2 = ValueList({"Test": 0, "Full": 1}, selected="Test")

pipeline = GeometryPipeline(
    GroupByLayer=False,
    GroupByType=False,
    IncludeHidden=True,
    IncludeLocked=True,
    LayerFilter="Continuous Toolpath0",
    NameFilter="*",
    SublayerFiltering=True,
    TypeFilter=4)
redpline = Reduce(Polyline=pipeline, Tolerance=Slider(0.2, range=0..0.5))  # -> Polyline, Reduction
crv = Curve(redpline.Polyline)

# ----
# Check Direction
end = EndPoints(Curve=crv)  # -> Start, End
pdecon = Deconstruct(Point=end.Start)  # -> XComponent, YComponent, ZComponent
pdecon_2 = Deconstruct(Point=end.End)  # -> XComponent, YComponent, ZComponent
larger = LargerThan(FirstNumber=pdecon.ZComponent, SecondNumber=pdecon_2.ZComponent)  # -> LargerThan, OrEqualTo
flip = FlipCurve(Curve=crv)  # -> Curve, Flag
weave = Weave(Pattern=larger.LargerThan, Stream0=crv, Stream1=flip.Curve, NullGaps=False)

# ----
# Select Points
explode = Explode(Curve=weave, Recursive=True)  # -> Segments, Vertices
split = SplitList(List=explode.Vertices, Index=test_amount_of_lines)  # -> ListA, ListB
filter = StreamFilter(Gate=list_2, Stream0=split.ListA, Stream1=explode.Vertices)

# ---- group: Layer Height
pdecon_3 = Deconstruct(Point=explode.Vertices)  # -> XComponent, YComponent, ZComponent
reldif = RelativeDifferences(Values=pdecon_3.ZComponent)
cset = CreateSet(List=reldif)  # -> Set, Map
equals = Equality(FirstNumber=cset.Set, SecondNumber=0)  # -> Equality, Inequality
cull = CullPattern(List=cset.Set, CullPattern=equals.Inequality)
lng = ListLength(List=cull)
should_be_1_check_this = Panel(lng)

# ---- group: Layer Width
filter_2 = StreamFilter(Gate=list, Stream0="0.4", Stream1="24")

# ----
python = GhPythonScript(
    printer=list,
    Pt=filter,
    LHeight=cull,
    LWidth=filter_2,
    Flow=flow,
    Temp=temperature,
    bTemp=bed_temperature,
    create=Button())  # -> out, a; inputs printer: Int32, Pt: list of Point3d, create: Boolean
# ---------- python: Python ----------
__author__ = "maxla"
__version__ = "2021.03.18"

import rhinoscriptsyntax as rs
import os
import Grasshopper as gh

#Global Variables:
gCode = []
startCode = []
mainCode = []
endCode = []
ptApproach = rs.CreatePoint(0, 0, 400)
ptStart = Pt[0] + ptApproach
ptEnd = Pt[len(Pt)-1] + ptApproach
curDirGH = ghdoc.Path
curDir = os.path.dirname(curDirGH)

#Printer specific start code:       Replace temperature etc.
ptStartString = str(format(ptStart[0], '.2f')) + ' Y' + str(format(ptStart[1], '.2f')) + ' Z' + str(format(ptStart[2], '.2f'))

if printer == 0: #Creality CR-X
    nSize = 0.4 #Nozzle Size (diameter)
    fSize = 1.75 #Filament Size (diameter)
    file = curDir+'\Start\Creality_CR-X.txt'
    print(file)
    with open(file, 'r') as startFile:
        startContent = startFile.readlines()
        for line in startContent:
            x = line[:-1]
            startCode.append(x)
    startCode.append('G0 F5700 X' + str(ptStartString))

if printer == 1: #Staubli 3DRobotPrinting
    nSize = 20 #Nozzle Size  (diameter)
    file = curDir+'\Start\Staubli_3DRobotPrinting.txt'
    print(file)
    with open(file, 'r') as startFile:
        startContent = startFile.readlines()
        for line in startContent:
            x = line[:-1]
            startCode.append(x)

btempString = 'S' + str(bTemp)
startCode = [x.replace('BED_TEMPERATURE', btempString) for x in startCode] #Set Bed Temperature

tempString = 'S' + str(Temp)
startCode = [x.replace('TEMPERATURE', tempString) for x in startCode] #Set Temperature

#Main code

eAcc = 0
for i in range(len(Pt)):
    ptX = format(Pt[i][0], '.2f')
    ptY = format(Pt[i][1], '.2f')
    ptZ = format(Pt[i][2], '.2f')
    e = 0
    
    if i > 0:
        ptZl = format(Pt[i-1][2], '.2f')
        d = Pt[i].DistanceTo(Pt[i-1])
        e = ((LHeight/2)*(LWidth/2)*d)/((fSize/2)**2)*Flow #Extrusion Amount
    else: 
        ptZl = -1
        e = 0
    eAcc += e
    
    if i == 0:
        mainCode.append('G0 F1800 X' + str(ptX) + ' Y' + str(ptY) + ' Z' + str(ptZ))
    if ptZ == ptZl:
        mainCode.append('G1 X' + str(ptX) + ' Y' + str(ptY) + ' E' + str(eAcc))
    else:
        mainCode.append('G1 X' + str(ptX) + ' Y' + str(ptY) + ' Z' + str(ptZ) + ' E' + str(eAcc))

print(mainCode[5])

#Add retract
ptEndString = 'G1 X' + str(format(ptEnd[0], '.2f')) + ' Y' + str(format(ptEnd[1], '.2f')) + ' Z' + str(format(ptEnd[2], '.2f'))
mainCode.append(ptEndString)


#End code:

if printer == 0: #Creality CR-X
    file = curDir+'\End\Creality_CR-X.txt'
    print(file)
    with open(file, 'r') as endFile:
        endContent = endFile.readlines()
        for line in endContent:
            x = line[:-1]
            endCode.append(x)


if printer == 1: #Staubli 3DRobotPrinting
    file = curDir+'\End\Staubli_3DRobotPrinting.txt'
    print(file)
    with open(file, 'r') as endFile:
        endContent = endFile.readlines()
        for line in endContent:
            x = line[:-1]
            endCode.append(x)


#Append code:
gCode = startCode + mainCode + endCode


outDir = os.path.dirname(os.path.dirname(curDir)) + ('\output')
print(outDir)

#Generate GCode:
if create == True:
    gcodeFile = open(outDir + '\print_file.gcode', 'w+')
    for i in range(len(gCode)):
        gcodeFile.write(gCode[i] + '\n')
    gcodeFile.close()
# ---------- end python ----------
